vi "PackageDetails.gviweb"   [LabVIEW NXG Preview 4.0.0]
panel controls:
  "Download": bool
  "Version": i32
panel indicators:
  "URL Image": string
  "DisplayName": string
  "PkgIcon": string
  "ReleaseDate": string
  "Vendor": string
  "Author": string
  "Description": string
  "Release Notes": string
  "Dependencies": string
  "PrototypedBy": string
  "Name": string
types:
  "Package Version.gtype" = cluster{"ReleaseDate": string, "Version": string, "Name": string, "DisplayName": string, "Description": string, "Vendor": string, "Author": string, "Release Notes": string, "Dependencies": string[], "IconURL": string, "PackageURL": string}
  T1 = cluster{"BaseURL": string, "Package Details": "Package Version.gtype", "All Versions": string[]}
uses:
  QMH support::Message Queue::Create All Message Queues.gviweb
  HTTP Client API::Base URL--constant.gvi
  QMH support::Message Queue::Dequeue Message.gviweb
  QMH support::Message Queue::Enqueue Message (Single).gviweb
  BusyStateAPI::BusyStateAPI.jsli::SetBusy
  HTTP Client API::Connection::Open Connection.gvi
  HTTP Client API::Packages::Get Package Details.gvi
  HTTP Client API::Packages::Get All Package Versions.gvi
  HTTP Client API::Connection::Close Connection.gvi
  BusyStateAPI::BusyStateAPI.jsli::UnsetBusy
  WebApp::Support::JSON Timestamp to Display.gvi
  WebApp::Support::Join Strings.gvi
  RedirectURL::Redirect.jsli::Redirect
  HTTP Client API::Packages::Set Package.gvi
  NI::G Core::Error::Read Error Code.gvi
  Error Handling::Error Handler.gvi
  NI::G Core::Error::Build Error Cluster.gvi
  QMH support::Error Handler - Message Handling Loop.gviweb
  QMH support::Error Handler - Event Handling Loop.gviweb
diagram:
  w1 = bool TRUE  # Stop Event
  Create User Event[EventName="Stop Event"](user event data type=w1) -> (error out=w2, user event out=w3)
  call "Create All Message Queues.gviweb"(error in=w2) -> (message queues=w4, error out=w5)
  call "Base URL--constant.gvi"() -> (Base URL=w6)
  Property Node(instance in=T1 {all zero or empty}, "BaseURL"=w6) -> (instance out=w7)
  Property Node(instance in=w4) -> ("UI"=w8)
  s1 = w7  # shift register
  while {
    call "Dequeue Message.gviweb"(message queue in=w8, error in=w5) -> (message queue out=w9, message=w10, message data=w11, error out=w12)
    # s1: Data
    # w3: Stop Event
    case (w10) ignore case {  # Message Cases
      frame "Initialize" {
        call "Enqueue Message (Single).gviweb"(message queue in=w9, message="Get Package Details", error in=w12) -> (error out=w13)
        w14 = s1
        w15 = default
      }
      frame "Get Package Details" {
        Property Node(instance in=s1) -> ("BaseURL"=w16, instance out=w17)
        call "SetBusy"(error in=w12) -> (error out=w18)
        call "Open Connection.gvi"(Root URL=w16, error in=w18) -> (Connection=w19, error out=w20)
        call "Get Package Details.gvi"(Connection in=w19, error in=w20) -> (Connection out=w21, Package Details=w22, error out=w23)
        call "Get All Package Versions.gvi"(Connection in=w21, error in=w23) -> (Connection out=w24, All Versions text=w25, error out=w26)
        Property Node(instance in=w17, "Package Details"=w22, "All Versions"=w25) -> (instance out=w14)
        call "Close Connection.gvi"(Connection in=w24, error in=w26) -> (error out=w27)
        call "UnsetBusy"(error in=w27) -> (error out=w28)
        call "Enqueue Message (Single).gviweb"(message queue in=w9, message="Display Package Details", error in=w28) -> (error out=w13)
        w15 = default
      }
      frame "Display Package Details" {
        Property Node(instance in=s1) -> ("Package Details"=w29, instance out=w14)
        Property Node(instance in=w29) -> ("Name"=w30, "DisplayName"=w31, "IconURL"=w32, "ReleaseDate"=w33, "Vendor"=w34, "Author"=w35, "Description"=w36, "Release Notes"=w37, "Dependencies"=w38)
        $Name <- w30
        $DisplayName <- w31
        $PkgIcon <- w32
        call "JSON Timestamp to Display.gvi"(JSON Timestamp=w33) -> (Display Timestamp=w39)
        $ReleaseDate <- w39
        $Vendor <- w34
        $Author <- w35
        $Description <- w36
        $"Release Notes" <- w37
        call "Join Strings.gvi"(String Array Input=w38, Separator="\r\n") -> (String output=w40)
        $Dependencies <- w40
        call "Enqueue Message (Single).gviweb"(message queue in=w9, message="Display Versions", error in=w12) -> (error out=w13)
        w15 = default
      }
      frame "Display Versions" {
        Property Node(instance in=s1) -> ("All Versions"=w41, "Package Details:Version"=w42, instance out=w14)
        Search 1D Array(1D array=w41, element=w42) -> (index of element=w43)
        Property Node(instance in=reference to "Version", "Items"=w41, "Value"=w43)
        w13 = w12
        w15 = default
      }
      frame "Version changed" {
        Property Node(instance in=s1) -> ("BaseURL"=w44, "Package Details:Name"=w45, "All Versions"=w46, instance out=w14)
        call "SetBusy"(error in=w12) -> (error out=w47)
        Decimal String To Number(string=w11) -> (number=w48)
        Array Index(array=w46) -> (out0[w48]=w49)
        Format Into String(formatString="%sPackage?Name=%s&Version=%s", w44, w45, w49) -> w50
        disable {
          frame Enabled {
            call "Redirect"(URL=w50, target="_parent", error in=w47) -> (error out=w51)
          }
          frame Disabled {
            call "Open Connection.gvi"(Root URL=w44, error in=w47) -> (Connection=w52, error out=w53)
            call "Set Package.gvi"(Connection in=w52, Name=w45, Version=w49, error in=w53) -> (Connection out=w54, error out=w55)
            call "Close Connection.gvi"(Connection in=w54, error in=w55) -> (error out=w56)
            call "Enqueue Message (Single).gviweb"(message queue in=w9, message="Get Package Details", error in=w56) -> (error out=w51)
          }
        }
        call "UnsetBusy"(error in=w51) -> (error out=w13)
        w15 = default
      }
      frame "Download Package" {
        Property Node(instance in=s1) -> ("Package Details:PackageURL"=w57, instance out=w14)
        call "SetBusy"(error in=w12) -> (error out=w58)
        call "Redirect"(URL=w57, target="_blank", error in=w58) -> (error out=w59)
        call "UnsetBusy"(error in=w59) -> (error out=w13)
        w15 = default
      }
      frame "Error" {
        # Process Error
        w60 = no error  # Error
        Unflatten From JSON(JSON string=w11, error in (no error)=w12, type and defaults=w60) -> (error out=w13, value=w61)
        call "Read Error Code.gvi"(error in=w61) -> (code=w62)
        case (w62) {
          frame 501401 {
            # Redirect to Login page
            call "Redirect"(URL="Login.html")
          }
          frame 0, Default {
            # Display Error
            call "Error Handler.gvi"(error in=w61)
          }
        }
        w14 = s1
        w15 = default
      }
      frame "---Copy This Frame---" {
        Merge Errors(w12) -> (error out=w13)
        w14 = s1
        w15 = default
      }
      frame "Exit" {
        # Release the message queue reference
        Release Queue(error in=w12, queue=w9) -> (error out=w63)
        Generate User Event(event data=TRUE, user event=w3) -> (error out=w64)
        Merge Errors(w64, w63) -> (error out=w13)
        # Stop the VI
        w14 = s1
        w15 = TRUE
      }
      frame Default {
        w65 = "The invalid message string \"%s\" was received in the Message Handling Loop."
        Format Into String(formatString=w65, w10) -> w66
        call "Build Error Cluster.gvi"(code=1, description=w66) -> (error out=w13)
        w14 = s1
        w15 = default
      }
    }
    call "Error Handler - Message Handling Loop.gviweb"(message queue in=w9, error in=w13) -> (dup error in=w67)
    next s1 = w14
    stop if w15
  }
  Register For Events("Stop Event"=w3) -> (event registration refnum out=w68)
  s2 = w68  # shift register
  while {
    event (dynamic events = s2) {
      on "Dynamic" Stop Event {
        # The Message Handling Loop processed an "Exit" message, which fired this event to stop the Event Handling Loop.
        w69 = TRUE
        w70 = no error
        w71 = w8
      }
      on "Download" Value changed {
        call "Enqueue Message (Single).gviweb"(message queue in=w8, message="Download Package") -> (message queue out=w71, error out=w70)
        w69 = default
      }
      on "Version" Value changed {
        Event Data() -> ("New Value"=w72)
        Number To Decimal String(number=w72) -> (decimal integer string=w73)
        call "Enqueue Message (Single).gviweb"(message queue in=w8, message="Version changed", message data=w73) -> (message queue out=w71)
        w69 = default
        w70 = default
      }
    }
    call "Error Handler - Event Handling Loop.gviweb"(message queue in=w71, error in=w70) -> (dup error in=w74)
    stop if w69
  }
  Unregister For Events(error in=w74, event registration refnum=s2) -> (error out=w75)
  Merge Errors(w75, w67) -> (error out=w76)
  Destroy User Event(error in=w76, user event=w3)
