vi "Packages.gviweb"   [LabVIEW NXG 4.0.0]
# This template is for the Queued Message Handler design pattern. The Event Handling Loop generates messages based on user interface actions. The Message Handling Loop processes messages generated by the Event Handling Loop, or by other messages. The messages are string values, so new messages can be added easily to the Message Cases case structure in the Message Handling Loop. Each message cluster can also provide an optional value for Message Data,  which is a String that can be swapped to whatever type of data is required.
panel controls:
  "Search": string
  "First": bool
  "Previous": bool
  "Next": bool
  "Last": bool
  "Package Details": bool
  "Repo Type": i32[]
  "Repo Name": i32[]
panel indicators:
  "Tree": T1[]
  "Status string": string
  "URL Image": string
  "PrototypedBy": string
types:
  T1 = cluster{"Element 0": string, "Data": string, "Data_2": string}
  "List Packages Settings--cluster.gtype" = cluster{"PageNumber": i32, "SearchCriteria": string, "Filters": "Package Filters.gtype"}
  "List Details--cluster.gtype" = cluster{"TotalPackages": i32, "TotalPages": i32, "PagesBefore": i32, "PagesAfter": i32, "ItemsPerPage": i32}
  "Package--cluster.gtype" = cluster{"Name": string, "DisplayName": string, "RepoType": string, "RepoName": string, "Versions": "Package Version--cluster.gtype"[]}
  T2 = cluster{"BaseURL": string, "Settings": "List Packages Settings--cluster.gtype", "List Details": "List Details--cluster.gtype", "Packages": "Package--cluster.gtype"[], "All Tags": string[]}
uses:
  QMH support::Message Queue::Create All Message Queues.gviweb
  HTTP Client API::Base URL--constant.gvi
  QMH support::Message Queue::Dequeue Message.gviweb
  QMH support::Message Queue::Enqueue Message (Single).gviweb
  BusyStateAPI::Set Busy.gviweb
  HTTP Client API::Connection::Open Connection.gvi
  HTTP Client API::Packages::List Packages.gvi
  HTTP Client API::Connection::Close Connection.gvi
  BusyStateAPI::Unset Busy.gviweb
  WebApp::Support::Format Packages for Tree Display.gvi
  HTTP Client API::Packages::Get Package Filters.gvi
  WebApp::Support::Build Status String.gvi
  RedirectURL::Redirect.jsli::Redirect
  NI::G Core::Error::Read Error Code.gvi
  Error Handling::Error Handler.gvi
  NI::G Core::Error::Build Error Cluster.gvi
  QMH support::Error Handler - Message Handling Loop.gviweb
  QMH support::Error Handler - Event Handling Loop.gviweb
diagram:
  w1 = bool TRUE  # Stop Event
  Create User Event[EventName="Stop Event"](user event data type=w1) -> (error out=w2, user event out=w3)
  call "Create All Message Queues.gviweb"(error in=w2) -> (message queues=w4, error out=w5)
  call "Base URL--constant.gvi"() -> (Base URL=w6)
  w7 = T2 {"BaseURL"="", "Settings"={"PageNumber"=1, "SearchCriteria"="", "Filters"={"RepoTypes"=[], "RepoNames"=[]}}, "List Details"={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}, "Packages"=[], "All Tags"=[]}
  Property Node(instance in=w7, "BaseURL"=w6) -> (instance out=w8)
  Property Node(instance in=w4) -> ("UI"=w9)
  s1 = w8  # shift register
  while {
    call "Dequeue Message.gviweb"(message queue in=w9, error in=w5) -> (message queue out=w10, message=w11, message data=w12, error out=w13)
    # s1: Data
    # w3: Stop Event
    case (w11) ignore case {  # Message Cases
      frame "Initialize" {
        Property Node(instance in=s1, "Settings:PageNumber"=1) -> (instance out=w15)
        Property Node(instance in=reference to "Tree", "ColumnHeaders"=["Name", "Vendor", "Repository"])
        call "Enqueue Message (Single).gviweb"(message queue in=w10, message="Get Filters", error in=w13) -> (message queue out=w17, error out=w18)
        call "Enqueue Message (Single).gviweb"(message queue in=w17, message="List Packages", error in=w18) -> (error out=w14)
        w16 = default
      }
      frame "List Packages" {
        Property Node(instance in=s1) -> ("BaseURL"=w19, "Settings"=w20, instance out=w21)
        call "Set Busy.gviweb"(error in=w13) -> (error out=w22)
        call "Open Connection.gvi"(Root URL=w19, error in=w22) -> (Connection=w23, error out=w24)
        call "List Packages.gvi"(Connection in=w23, List Packages Settings=w20, error in=w24) -> (Connection out=w25, Packages=w26, List Details=w27, error out=w28)
        Property Node(instance in=w21, "Packages"=w26, "List Details"=w27) -> (instance out=w15)
        call "Close Connection.gvi"(Connection in=w25, error in=w28) -> (error out=w29)
        call "Unset Busy.gviweb"(error in=w29) -> (error out=w30)
        call "Enqueue Message (Single).gviweb"(message queue in=w10, message="Display Packages List", error in=w30) -> (error out=w14)
        w16 = default
      }
      frame "Display Packages List" {
        Property Node(instance in=s1) -> ("Packages"=w31, instance out=w32)
        call "Set Busy.gviweb"(error in=w13) -> (error out=w33)
        call "Format Packages for Tree Display.gvi"(Packages=w31, error in=w33) -> (Packages Tree=w34, All Tags=w35, error out=w36)
        $Tree <- w34
        Property Node(instance in=w32, "All Tags"=w35) -> (instance out=w15)
        call "Unset Busy.gviweb"(error in=w36) -> (error out=w37)
        call "Enqueue Message (Single).gviweb"(message queue in=w10, message="Refresh Controls", error in=w37) -> (error out=w14)
        # Force reset scroll position
        Array Index(array=w35) -> (out0[0]=w38)
        Open Tree Item(reference in=reference to "Tree", location=w38) -> (reference out=w39)
        Close Tree Item(reference in=w39, location=w38)
        w16 = default
      }
      frame "Get Filters" {
        Property Node(instance in=s1) -> ("BaseURL"=w40, instance out=w41)
        call "Set Busy.gviweb"(error in=w13) -> (error out=w42)
        call "Open Connection.gvi"(Root URL=w40, error in=w42) -> (Connection=w43, error out=w44)
        call "Get Package Filters.gvi"(Connection in=w43, error in=w44) -> (Connection out=w45, Filters=w46, error out=w47)
        Property Node(instance in=w46) -> ("RepoTypes"=w48, "RepoNames"=w49)
        Array Index(array=w48) -> (out0[_]=w50)
        Build Array(w50) -> w51
        Array Index(array=w49) -> (out0[_]=w52)
        Build Array(w52) -> w53
        Property Node(instance in=w41, "Settings:Filters:RepoTypes"=w51, "Settings:Filters:RepoNames"=w53) -> (instance out=w15)
        Property Node(instance in=reference to "Repo Type", "Items"=w48, "Value"=[0])
        Property Node(instance in=reference to "Repo Name", "Items"=w49, "Value"=[0])
        call "Close Connection.gvi"(Connection in=w45, error in=w47) -> (error out=w54)
        call "Unset Busy.gviweb"(error in=w54) -> (error out=w14)
        w16 = default
      }
      frame "Search value changed" {
        Property Node(instance in=s1) -> ("Settings"=w55, instance out=w56)
        Property Node(instance in=w55, "SearchCriteria"=w12, "PageNumber"=1) -> (instance out=w57)
        Property Node(instance in=w56, "Settings"=w57) -> (instance out=w15)
        Flatten To JSON(anything=w57) -> (JSON string=w58)
        call "Enqueue Message (Single).gviweb"(message queue in=w10, message="List Packages", message data=w58, error in=w13) -> (error out=w14)
        w16 = default
      }
      frame "Tree Selection Changed" {
        call "Enqueue Message (Single).gviweb"(message queue in=w10, message="Refresh Controls", error in=w13) -> (error out=w14)
        w15 = s1
        w16 = default
      }
      frame "Refresh Controls" {
        Build Array(reference to "First", reference to "Previous", reference to "Next", reference to "Last") -> w59
        Property Node(instance in=s1) -> ("List Details:PagesBefore"=w60, "List Details:PagesAfter"=w61, "Settings"=w62, "List Details"=w63, instance out=w15)
        Is Equal To 0(x=w60) -> w64
        case (w64) {
          frame False, Default {
            w65 = FALSE
            w66 = FALSE
          }
          frame True {
            w65 = TRUE
            w66 = TRUE
          }
        }
        Is Equal To 0(x=w61) -> w67
        case (w67) {
          frame False, Default {
            w68 = FALSE
            w69 = FALSE
          }
          frame True {
            w68 = TRUE
            w69 = TRUE
          }
        }
        Build Array(w65, w66, w68, w69) -> w70
        for {
          w71 = each element of w70
          w72 = each element of w59
          Property Node(instance in=w72, "Disabled"=w71)
        }
        call "Build Status String.gvi"(List Package settings=w62, List Details=w63) -> (Status String=w73)
        $"Status string" <- w73
        Property Node(instance in=reference to "Tree") -> ("SelectedData"=w74)
        Property Node(instance in=w74) -> ("Element 0"=w75)
        Is Empty String Or Path(string/path=w75) -> w76
        Property Node(instance in=reference to "Package Details", "Disabled"=w76)
        w14 = w13
        w16 = default
      }
      frame "Show Package Details" {
        call "Set Busy.gviweb"(error in=w13) -> (error out=w77)
        Property Node(instance in=s1) -> ("Packages"=w78, "All Tags"=w79, instance out=w15)
        Property Node(instance in=reference to "Tree") -> ("SelectedData"=w80)
        Property Node(instance in=w80) -> ("Element 0"=w81)
        Search 1D Array(1D array=w79, element=w81) -> (index of element=w82)
        Array Index(array=w78) -> (out0[w82]=w83)
        Property Node(instance in=w83) -> ("Name"=w84)
        Concatenate Strings("PackageDetails.html?Name=", w84) -> w85
        call "Redirect"(URL=w85, target="_blank", error in=w77) -> (error out=w86)
        call "Unset Busy.gviweb"(error in=w86) -> (error out=w14)
        w16 = default
      }
      frame "Repo Type changed" {
        Unflatten From JSON(JSON string=w12, type and defaults=i32[] []) -> (value=w87)
        Is Empty Array(array=w87) -> w88
        case (w88) {
          frame False, Default {
            w89 = w87
          }
          frame True {
            w89 = [0]
          }
        }
        Property Node(instance in=reference to "Repo Type", "Value"=w89) -> ("Items"=w90)
        for {
          w91 = each element of w89
          Array Index(array=w90) -> (out0[w91]=w93)
          append w93 to w92
        }
        Property Node(instance in=s1, "Settings:Filters:RepoTypes"=w92) -> (instance out=w15)
        call "Enqueue Message (Single).gviweb"(message queue in=w10, message="List Packages", error in=w13) -> (error out=w14)
        w16 = default
      }
      frame "Repo Name changed" {
        Unflatten From JSON(JSON string=w12, type and defaults=i32[] []) -> (value=w94)
        Is Empty Array(array=w94) -> w95
        case (w95) {
          frame False, Default {
            w96 = w94
          }
          frame True {
            w96 = [0]
          }
        }
        Property Node(instance in=reference to "Repo Name", "Value"=w96) -> ("Items"=w97)
        for {
          w98 = each element of w96
          Array Index(array=w97) -> (out0[w98]=w100)
          append w100 to w99
        }
        Property Node(instance in=s1, "Settings:Filters:RepoNames"=w99) -> (instance out=w15)
        call "Enqueue Message (Single).gviweb"(message queue in=w10, message="List Packages", error in=w13) -> (error out=w14)
        w16 = default
      }
      frame "First" {
        Property Node(instance in=s1) -> ("Settings"=w101, instance out=w102)
        Property Node(instance in=w101, "PageNumber"=1) -> (instance out=w103)
        Property Node(instance in=w102, "Settings"=w103) -> (instance out=w15)
        Flatten To JSON(anything=w103) -> (JSON string=w104)
        call "Enqueue Message (Single).gviweb"(message queue in=w10, message="List Packages", message data=w104, error in=w13) -> (error out=w14)
        w16 = default
      }
      frame "Last" {
        Property Node(instance in=s1) -> ("Settings"=w105, "List Details:TotalPages"=w106, instance out=w107)
        Property Node(instance in=w105, "PageNumber"=w106) -> (instance out=w108)
        Property Node(instance in=w107, "Settings"=w108) -> (instance out=w15)
        Flatten To JSON(anything=w108) -> (JSON string=w109)
        call "Enqueue Message (Single).gviweb"(message queue in=w10, message="List Packages", message data=w109, error in=w13) -> (error out=w14)
        w16 = default
      }
      frame "Previous" {
        Property Node(instance in=s1) -> ("Settings"=w110, "Settings:PageNumber"=w111, instance out=w112)
        Decrement(x=w111) -> w113
        Property Node(instance in=w110, "PageNumber"=w113) -> (instance out=w114)
        Property Node(instance in=w112, "Settings"=w114) -> (instance out=w15)
        Flatten To JSON(anything=w114) -> (JSON string=w115)
        call "Enqueue Message (Single).gviweb"(message queue in=w10, message="List Packages", message data=w115, error in=w13) -> (error out=w14)
        w16 = default
      }
      frame "Next" {
        Property Node(instance in=s1) -> ("Settings"=w116, "Settings:PageNumber"=w117, instance out=w118)
        Increment(x=w117) -> w119
        Property Node(instance in=w116, "PageNumber"=w119) -> (instance out=w120)
        Property Node(instance in=w118, "Settings"=w120) -> (instance out=w15)
        Flatten To JSON(anything=w120) -> (JSON string=w121)
        call "Enqueue Message (Single).gviweb"(message queue in=w10, message="List Packages", message data=w121, error in=w13) -> (error out=w14)
        w16 = default
      }
      frame "Error" {
        # Process Error
        w122 = no error  # Error
        Unflatten From JSON(JSON string=w12, error in (no error)=w13, type and defaults=w122) -> (error out=w14, value=w123)
        call "Read Error Code.gvi"(error in=w123) -> (code=w124)
        case (w124) {
          frame 501401 {
            # Redirect to Login page
            call "Redirect"(URL="Login.html")
          }
          frame 0, Default {
            # Display Error
            call "Error Handler.gvi"(error in=w123)
          }
        }
        w15 = s1
        w16 = default
      }
      frame "---Copy This Frame---" {
        Merge Errors(w13) -> (error out=w14)
        w15 = s1
        w16 = default
      }
      frame "Exit" {
        # Release the message queue reference
        Release Queue(error in=w13, queue=w10) -> (error out=w125)
        Generate User Event(event data=TRUE, user event=w3) -> (error out=w126)
        Merge Errors(w126, w125) -> (error out=w14)
        # Stop the VI
        w15 = s1
        w16 = TRUE
      }
      frame Default {
        w127 = "The invalid message string \"%s\" was received in the Message Handling Loop."
        Format Into String(formatString=w127, w11) -> w128
        call "Build Error Cluster.gvi"(code=1, description=w128) -> (error out=w14)
        w15 = s1
        w16 = default
      }
    }
    call "Error Handler - Message Handling Loop.gviweb"(message queue in=w10, error in=w14) -> (dup error in=w129)
    next s1 = w15
    stop if w16
  }
  Register For Events("Stop Event"=w3) -> (event registration refnum out=w130)
  s2 = w130  # shift register
  while {
    event (dynamic events = s2) {
      on dynamic event 0 {
        # The Message Handling Loop processed an "Exit" message, which fired this event to stop the Event Handling Loop.
        w131 = TRUE
        w132 = no error
        w133 = w9
      }
      on "Tree" Selection changed {
        Event Data() -> ("NewSelection"=w134)
        call "Enqueue Message (Single).gviweb"(message queue in=w9, message="Tree Selection Changed", message data=w134) -> (message queue out=w133, error out=w132)
        w131 = default
      }
      on "Search" Value changed {
        Event Data() -> ("New Value"=w135)
        call "Enqueue Message (Single).gviweb"(message queue in=w9, message="Search value changed", message data=w135) -> (message queue out=w133, error out=w132)
        w131 = default
      }
      on "First" Value changed {
        call "Enqueue Message (Single).gviweb"(message queue in=w9, message="First") -> (message queue out=w133, error out=w132)
        w131 = default
      }
      on "Last" Value changed {
        call "Enqueue Message (Single).gviweb"(message queue in=w9, message="Last") -> (message queue out=w133, error out=w132)
        w131 = default
      }
      on "Next" Value changed {
        call "Enqueue Message (Single).gviweb"(message queue in=w9, message="Next") -> (message queue out=w133, error out=w132)
        w131 = default
      }
      on "Previous" Value changed {
        call "Enqueue Message (Single).gviweb"(message queue in=w9, message="Previous") -> (message queue out=w133, error out=w132)
        w131 = default
      }
      on "Package Details" Value changed {
        call "Enqueue Message (Single).gviweb"(message queue in=w9, message="Show Package Details") -> (message queue out=w133, error out=w132)
        w131 = default
      }
      on "Repo Type" Value changed {
        Event Data() -> ("Old Value"=w136, "New Value"=w137)
        Is Equal[ComparisonMode=CompareAggregates](x=w136, y=[0]) -> w138
        case (w138) {
          frame False, Default {
            Search 1D Array(1D array=w136, element=0) -> (index of element=w140)
            case (w140) {
              frame -1 {
                Search 1D Array(1D array=w137, element=0) -> (index of element=w141)
                Is Greater Or Equal To 0(x=w141) -> w142
                Select(s=w142, t=[0], f=w137) -> w139
              }
              frame Default {
                Delete From Array(inArray=w137, index0=w140) -> w139
              }
            }
          }
          frame True {
            Search 1D Array(1D array=w137, element=0) -> (index of element=w143)
            Delete From Array(inArray=w137, index0=w143) -> w139
          }
        }
        Flatten To JSON(anything=w139) -> (JSON string=w144)
        call "Enqueue Message (Single).gviweb"(message queue in=w9, message="Repo Type changed", message data=w144) -> (message queue out=w133)
        w131 = default
        w132 = default
      }
      on "Repo Name" Value changed {
        Event Data() -> ("Old Value"=w145, "New Value"=w146)
        Is Equal[ComparisonMode=CompareAggregates](x=w145, y=[0]) -> w147
        case (w147) {
          frame False, Default {
            Search 1D Array(1D array=w145, element=0) -> (index of element=w149)
            case (w149) {
              frame -1 {
                Search 1D Array(1D array=w146, element=0) -> (index of element=w150)
                Is Greater Or Equal To 0(x=w150) -> w151
                Select(s=w151, t=[0], f=w146) -> w148
              }
              frame Default {
                Delete From Array(inArray=w146, index0=w149) -> w148
              }
            }
          }
          frame True {
            Search 1D Array(1D array=w146, element=0) -> (index of element=w152)
            Delete From Array(inArray=w146, index0=w152) -> w148
          }
        }
        Flatten To JSON(anything=w148) -> (JSON string=w153)
        call "Enqueue Message (Single).gviweb"(message queue in=w9, message="Repo Name changed", message data=w153) -> (message queue out=w133)
        w131 = default
        w132 = default
      }
    }
    call "Error Handler - Event Handling Loop.gviweb"(message queue in=w133, error in=w132) -> (dup error in=w154)
    stop if w131
  }
  Unregister For Events(error in=w154, event registration refnum=s2) -> (error out=w155)
  Merge Errors(w155, w129) -> (error out=w156)
  Destroy User Event(error in=w156, user event=w3)
